# Dynamo graph CreateLevels_Design.dyn (Dynamo 3.0.0.0)
# Creates 52 Revit Levels using a native DesignScript code block to generate elevations and names, then Level.ByElevationAndName to build the levels. No Python required. Elevation and floor-height inputs are in Revit internal units (decimal feet) regardless of the project's display units.

# group: INPUTS
# Count, floor height, base elevation and name prefix. Change the prefix if the project already has levels named "Level 1", "Level 2"… to avoid duplicate-name errors.
# note: Create 52 Levels  –  Revit 2027 (native DesignScript, no Python)
number_of_levels_52 = DoubleInput(52)  # graph input
base_elevation_ft_0_0 = DoubleInput(0)  # graph input
floor_to_floor_height_ft_13_0 = DoubleInput(13)  # graph input
level_name_prefix_level = StringInput("Level ")  # graph input

# group: PROCESS
# DesignScript code block computes elevations/names, then Level.ByElevationAndName creates each Level (Auto replication = one call per pair).
build_elevations_names = CodeBlock(count=number_of_levels_52, baseElevation=base_elevation_ft_0_0, floorHeight=floor_to_floor_height_ft_13_0, prefix=level_name_prefix_level) { indices = 0..(count - 1); elevations = baseElevation + indices * floorHeight; names = prefix + (indices + 1); }
byElevationAndName = Level.ByElevationAndName(elevation=build_elevations_names.elevations, name=build_elevations_names.names)
count = List.Count(list=byElevationAndName)

# group: OUTPUTS
# Review the created Level elements and confirm the count equals 52.
watch_created_levels = Watch(byElevationAndName)  # graph output
watch_level_count = Watch(count)  # graph output
