# Dynamo graph CreateRevitLevels.dyn (Dynamo 2.19.0.0)
# Creates Revit Levels from a list of names and elevations (in millimetres).
# packages: PythonNodeModels 3.0.0

# note: 1  Edit Level Names and Elevations (mm)
# 2  Set Run = True
# 3  Watch node shows created levels
level_names = CodeBlock { {"Ground Floor", "Level 1", "Level 2", "Level 3", "Roof"}; }  # graph input
elevations_mm = CodeBlock { {0, 3000, 6000, 9000, 12000}; }  # graph input
run = BoolSelector(false)  # graph input
create_revit_levels = Python(IN[0]=level_names, IN[1]=elevations_mm, IN[2]=run)  # CPython3
# ---------- create_revit_levels.python (46 lines) ----------
import clr
clr.AddReference('RevitAPI')
clr.AddReference('RevitAPIUI')
clr.AddReference('RevitServices')

from Autodesk.Revit.DB import Level
from RevitServices.Persistence import DocumentManager
from RevitServices.Transactions import TransactionManager

doc = DocumentManager.Instance.CurrentDBDocument

level_names   = IN[0] if isinstance(IN[0], list) else [IN[0]]
elevations_mm = IN[1] if isinstance(IN[1], list) else [IN[1]]
run_flag      = IN[2]

MM_TO_FT = 1.0 / 304.8

if not run_flag:
    OUT = "Toggle the Run input to True to execute."
elif len(level_names) != len(elevations_mm):
    OUT = "Error: Level names count ({}) must match elevations count ({}).".format(
        len(level_names), len(elevations_mm)
    )
else:
    created = []
    skipped = []

    TransactionManager.Instance.EnsureInTransaction(doc)

    for name, elev_mm in zip(level_names, elevations_mm):
        try:
            elev_ft = float(elev_mm) * MM_TO_FT
            level   = Level.Create(doc, elev_ft)
            level.Name = str(name)
            created.append("{} @ {} mm".format(name, elev_mm))
        except Exception as ex:
            skipped.append("{}: {}".format(name, str(ex)))

    TransactionManager.Instance.TransactionTaskDone()

    lines = ["Created ({}) Level(s):".format(len(created))]
    lines += ["  " + s for s in created]
    if skipped:
        lines += ["", "Skipped ({}) - already exists or name conflict:".format(len(skipped))]
        lines += ["  " + s for s in skipped]
    OUT = "\n".join(lines)
# ----------------------------------------
result = Watch(create_revit_levels)
