# Dynamo graph SetRevitComment.dyn (Dynamo 2.19.0.0)
# Writes 'Shree Radheladdumithumithuji' into the Comments parameter of all selected Revit elements.
# packages: PythonNodeModels 3.0.0

# note: 1  Select elements in Revit
# 2  Set Run = True
# 3  Watch node shows result
comment_text = CodeBlock { "Shree Radheladdumithumithuji"; }  # graph input
run = BoolSelector(true)  # graph input
set_comments_parameter = Python(IN[0]=comment_text, IN[1]=run)  # CPython3
# ---------- set_comments_parameter.python (43 lines) ----------
# Dynamo Python Script Node
import clr
clr.AddReference('RevitAPI')
clr.AddReference('RevitAPIUI')
clr.AddReference('RevitServices')

from Autodesk.Revit.DB import BuiltInParameter
from RevitServices.Persistence import DocumentManager
from RevitServices.Transactions import TransactionManager

doc   = DocumentManager.Instance.CurrentDBDocument
uidoc = DocumentManager.Instance.CurrentUIApplication.ActiveUIDocument

comment_text = IN[0]
run_flag     = IN[1]

if not run_flag:
    OUT = "Toggle Run to True to execute."
else:
    selected_ids = uidoc.Selection.GetElementIds()
    elements     = [doc.GetElement(eid) for eid in selected_ids]

    if not elements:
        OUT = "No elements selected - select elements in Revit, then re-run."
    else:
        updated = []
        skipped = []

        TransactionManager.Instance.EnsureInTransaction(doc)

        for el in elements:
            param = el.get_Parameter(BuiltInParameter.ALL_MODEL_INSTANCE_COMMENTS)
            if param is not None and not param.IsReadOnly:
                param.Set(comment_text)
                updated.append(el.Id.IntegerValue)
            else:
                skipped.append(el.Id.IntegerValue)

        TransactionManager.Instance.TransactionTaskDone()

        OUT = ("Comment written : '{}'\nUpdated ({}) IDs : {}\nSkipped ({}) IDs : {}").format(
            comment_text, len(updated), updated, len(skipped), skipped
        )
# ----------------------------------------
result = Watch(set_comments_parameter)
