# Dynamo graph SetRevitComment_Design.dyn (Dynamo 2.19.0.0)
# Writes 'Shree Radheladdumithumithuji' into the Comments parameter of selected Revit elements using native Dynamo nodes. Includes verification and element count output.

# group: INPUTS
# Select elements in Revit canvas, then define the parameter name and comment text.
# note: Set Revit Comments Parameter  –  Shree Radheladdumithumithuji
select_model_elements = DSModelElementsSelection()  # nothing selected; graph input
parameter_name_comments = StringInput("Comments")  # graph input
comment_value_shree = StringInput("Shree Radheladdumithumithuji")  # "Comment Value → "Shree Radheladdumithumithuji""; graph input

# group: PROCESS
# Write the comment value, then read it back to confirm. Also count total elements.
setParameterByName = Element.SetParameterByName(element=select_model_elements, parameterName=parameter_name_comments, value=comment_value_shree)
getParameterValueByName = Element.GetParameterValueByName(element=setParameterByName, parameterName=parameter_name_comments)
count = List.Count(list=select_model_elements)

# group: OUTPUTS
# Review updated element list, verified comment values, and total count.
watch_updated_elements = Watch(setParameterByName)  # graph output
watch_verified_comments = Watch(getParameterValueByName)  # graph output
watch_element_count = Watch(count)  # graph output
